vi "AddFrameHeader(Complex).gvi"   [LabVIEW NXG]
inputs:
  "Array in": c128[]
outputs:
  "Array out": c128[]
diagram:
  # 13-bit Barker code, repeated
  w1 = [0.707+0.707i, 0.707+0.707i, 0.707+0.707i, 0.707+0.707i, 0.707+0.707i, -0.707-0.707i, -0.707-0.707i, 0.707+0.707i, 0.707+0.707i, -0.707-0.707i, 0.707+0.707i, -0.707-0.707i, 0.707+0.707i]
  Build Array[ConcatenateInputs=True](w1, w1) -> w2
  Insert Into Array(inArray=$"Array in", index0=0, new=w2) -> w3
  $"Array out" <- w3
