vi "Channel.gvi"   [LabVIEW NXG]
inputs:
  "Received Signal In": cluster{"t0": f64, "dt": f64, "Y": c128[]} = {"t0"=0, "dt"=1, "Y"=[]}
  "Samples per Symbol": f64 = 20
  "error in": error
  "ISI Channel Model": c128[] = [1+0i, 0.2+0i, -0.08+0i]
  "Propagation Delay": f64 = 0.0001
  "Use Channel": bool
  "Eb/N0": f64 = Inf
outputs:
  "Received Signal Out": cluster{"t0": f64, "dt": f64, "Y": c128[]}
  "error out": error
panel indicators:
  "Upsampling Ratio (actual)": f64
diagram:
  case ($"error in") {
    frame No Error {
      Property Node(instance in=$"Received Signal In") -> (instance out=w3, "Y"=w4, "dt"=w5)
      Divide(x=$"Propagation Delay", y=w5) -> w6
      Round To Nearest(number=w6) -> w7
      call "Upsample (CDB).gvi"(x=$"ISI Channel Model", upsampling factor=w7) -> (upsampled array=w8, error=w9)
      call "1D Convolution (CDB).gvi"(x=w4, y=w8) -> (x * y=w10, error=w11)
      call "Error Cluster From Error Code.gvi"(error code (0)=w9, error message ("")="upsampling", error in (no error)=$"error in") -> (Error Out=w12)
      call "Error Cluster From Error Code.gvi"(error code (0)=w11, error message ("")="convolution", error in (no error)=w12) -> (Error Out=w13)
      Property Node(instance in=w3, "Y"=w10) -> (instance out=w14)
      call "MT Add AWGN.gvi"(input complex waveform=w14, samples per symbol=$"Samples per Symbol", eb/n0=$"Eb/N0", error in=w13) -> (output complex waveform=w15, error out=w2)
      Select(s=$"Use Channel", t=w15, f=w3) -> w1
      $"Upsampling Ratio (actual)" <- w7
    }
    frame Error {
      w1 = $"Received Signal In"
      w2 = $"error in"
    }
  }
  $"Received Signal Out" <- w1
  $"error out" <- w2
