vi "PulseAlign(complex).gvi"   [LabVIEW NXG]
inputs:
  "Input Signal": cluster{"t0": f64, "dt": f64, "Y": c128[]}
  "Receiver Sampling Factor": i32 = 100
  "error in (no error)": error
outputs:
  "Output Signal": cluster{"t0": f64, "dt": f64, "Y": c128[]}
  "alignment offset (samples)": i32
  "error out": error
panel indicators:
  "Objective Function": f64[]
diagram:
  Property Node(instance in=$"Input Signal") -> ("Y"=w1)
  for (N = $"Receiver Sampling Factor") (iteration -> i1) {
    Array Subset(array=w1, index0=i1) -> w3
    call "Decimate (single shot, CDB).gvi"(x=w3, decimating factor=$"Receiver Sampling Factor") -> (decimated array=w4)
    Complex To Polar(r * e^(i*theta)=w4) -> (r=w5)
    Square(x=w5) -> w6
    Add Array Elements(numeric array=w6) -> (sum=w7)
    append w7 to w2
  }
  Array Max And Min(array=w2) -> (max index(es)=w8)
  Array Subset(array=w1, index0=w8) -> w9
  Property Node(instance in=$"Input Signal", "Y"=w9) -> (instance out=w10)
  $"Output Signal" <- w10
  $"Objective Function" <- w2
  $"alignment offset (samples)" <- w8
  $"error out" <- $"error in (no error)"
