vi "Impulse Pattern.gvi"   [LabVIEW NXG]
inputs:
  "samples": i32 = 128
  "amplitude": f64 = 1
  "delay": i32
outputs:
  "Impulse Pattern": f64[]
  "error": i32
diagram:
  Initialize Array(element=0, size=$samples) -> w1
  Multiply($amplitude, 1) -> w2
  Replace Array Subset(inArray=w1, $delay, w2) -> w3
  $"Impulse Pattern" <- w3
