vi "Sine Waveform.gvi"   [LabVIEW NXG]
inputs:
  "frequency": f64 = 10
  "amplitude": f64 = 1
  "phase": f64
  "error in (no error)": error
  "reset signal": bool
  "offset": f64
  "sampling info": cluster{"Fs": f64, "#s": f64} = {"Fs"=1000, "#s"=1000}
outputs:
  "signal out": waveform<f64>
  "Error Out": error
diagram:
  case ($"error in (no error)") {
    frame No Error {
      Is First Call() -> w3
      Logical Or($"reset signal", w3) -> w4
      call "ma_Trap Fgen Parameter Errors.gvi"(frequency=$frequency, error in (no error)=$"error in (no error)", Sampling info=$"sampling info") -> (Error Out=w5)
      case (w5) {
        frame No Error {
          s1 = uninitialised  # shift register
          s2 = uninitialised  # shift register
          while {
            Property Node(instance in=$"sampling info") -> ("Fs"=w6, "#s"=w7)
            call "ma_Updatet0 timestamp.gvi"(Reset Generation=w4, tf previous=s2, sampling rate (S/s)=w6, samples=w7) -> (t0=w8, tf new=w9)
            Reciprocal(x=w6) -> w10
            Build Waveform Node(dt=w10, t0=w8) -> (output waveform=w11)
            case (w4) {
              frame False, Default {
                w12 = s1
              }
              frame True {
                w12 = $phase
              }
            }
            Divide(x=$frequency, y=w6) -> w13
            call "Sine Wave.gvi"(samples=w7, amplitude=$amplitude, frequency=w13, phase in=w12, reset phase=w4) -> (sine wave=w14, phase out=w15, error=w16)
            Add($offset, w14) -> w17
            s3 = w11  # shift register
            while {
              Property Node(instance in=s3) -> (instance out=w18, "Y"=w19)
              case (TRUE) {
                frame False {
                  w20 = w19
                }
                frame True {
                  w20 = w17
                }
              }
              Property Node(instance in=w18, "Y"=w20) -> (instance out=w21)
              next s3 = w21
              stop if TRUE
            }
            call "ma_basicErrorCode2ErrorCluster.gvi"(Error Code=w16, subVI name="Sine Wave.vi", error in (no error)=w5) -> (Error Out=w1)
            next s1 = w15
            next s2 = w9
            stop if TRUE
          }
          w2 = s3
        }
        frame Error {
          call "ma_patchErrorCode or Caller as Source.gvi"(operation=1, error in (no error)=w5) -> (Error Out=w1)
          w2 = default
        }
      }
    }
    frame Error {
      w1 = $"error in (no error)"
      w2 = default
    }
  }
  $"signal out" <- w2
  $"Error Out" <- w1
