vi "Std Deviation and Variance.gvi"   [LabVIEW NXG]
inputs:
  "X": f64[]
  "Weighting (Sample)": enum{"Sample", "Population"} = "Sample"
outputs:
  "mean": f64
  "standard deviation": f64
  "variance": f64
diagram:
  Array Size(array=$X) -> (size(s)=w1)
  # n
  To Double Precision Float(number=w1) -> w2
  # Population standard deviation
  # Sample standard deviation
  case ($"Weighting (Sample)") {
    frame "Sample" {
      Decrement(x=w2) -> w3
    }
    frame "Population" {
      w3 = w2
    }
  }
  # sum of x
  Add Array Elements(numeric array=$X) -> (sum=w4)
  Divide(x=w4, y=w2) -> w5
  Subtract(x=$X, y=w5) -> w6
  Multiply(w6, w6) -> w7
  # sum of squares of deviation
  Add Array Elements(numeric array=w7) -> (sum=w8)
  Divide(x=w8, y=w3) -> w9
  Square Root(x=w9) -> w10
  $"standard deviation" <- w10
  $mean <- w5
  $variance <- w9
