vi "ListeningTheOutputs.gvi"   [LabVIEW Communications System Design Software 2.0.1]
panel controls:
  "adc.m path": path = path "C:\\Users\\MSI\\Documents\\MATLAB\\5\\EE3001\\MATLAB Exercises\\Project\\newsound"
panel indicators:
  "Error-Corrected Signal": f64[]
  "Error-Impacted Signal": f64[]
  "RLS Output": f64[]
  "RLS Output without Hampell": f64[]
types:
  "Sound Data Format.gtype" = cluster{"sample rate (S/s)": f64, "number of channels": i32, "bits per sample": i32}
diagram:
  Path To String(path=$"adc.m path") -> (string=w1)
  Concatenate Strings(w1, "\\noisySpeech.txt") -> w2
  String To Path(string=w2) -> (path=w3)
  while {
    Wait(time to wait=500)
    Open Or Create Or Replace File(file path (use dialog)=w3) -> (error out=w4)
    call "Is Error.gvi"(error in=w4) -> (is error?=w5)
    Not(x=w5) -> w6
    stop if w6
  }
  call "Read from Spreadsheet File (DBL).gvi"(file path=w3, transpose?=TRUE) -> (all rows=w7)
  Array Index(array=w7) -> (out0[_, 0]=w8)
  Path To String(path=$"adc.m path") -> (string=w9)
  Concatenate Strings(w9, "\\AWGNnoisySpeech.txt") -> w10
  String To Path(string=w10) -> (path=w11)
  while {
    Wait(time to wait=500)
    Open Or Create Or Replace File(file path (use dialog)=w11) -> (error out=w12)
    call "Is Error.gvi"(error in=w12) -> (is error?=w13)
    Not(x=w13) -> w14
    stop if w14
  }
  call "Read from Spreadsheet File (DBL).gvi"(file path=w11, transpose?=TRUE) -> (all rows=w15)
  Array Index(array=w15) -> (out0[_, 0]=w16)
  Path To String(path=$"adc.m path") -> (string=w17)
  Concatenate Strings(w17, "\\rlsOutput.txt") -> w18
  String To Path(string=w18) -> (path=w19)
  while {
    Wait(time to wait=500)
    Open Or Create Or Replace File(file path (use dialog)=w19) -> (error out=w20)
    call "Is Error.gvi"(error in=w20) -> (is error?=w21)
    Not(x=w21) -> w22
    stop if w22
  }
  call "Read from Spreadsheet File (DBL).gvi"(file path=w19) -> (all rows=w23)
  Array Index(array=w23) -> (out0[_, 0]=w24)
  # Read the RLS output text file created by MATLAB
  Path To String(path=$"adc.m path") -> (string=w25)
  Concatenate Strings(w25, "\\rlsOutput_raw.txt") -> w26
  String To Path(string=w26) -> (path=w27)
  while {
    Wait(time to wait=500)
    Open Or Create Or Replace File(file path (use dialog)=w27) -> (error out=w28)
    call "Is Error.gvi"(error in=w28) -> (is error?=w29)
    Not(x=w29) -> w30
    stop if w30
  }
  call "Read from Spreadsheet File (DBL).gvi"(file path=w27) -> (all rows=w31)
  Array Index(array=w31) -> (out0[_, 0]=w32)
  Build Array(w32, w24) -> w33
  Build Array[ConcatenateInputs=True](w16, w8, w33) -> w34
  # Play the sounds
  for {
    w35 = each element of w34
    Build Waveform Node(Y=w35) -> (output waveform=w36)
    Build Array(w36) -> w37
    w38 = "Sound Data Format.gtype" {"sample rate (S/s)"=8000, "number of channels"=1, "bits per sample"=16}
    call "Sound Output Configure.gvi"(device ID=0, sound format=w38) -> (task ID=w39, error out=w40)
    call "Sound Output Start.gvi"(task ID in=w39, error in=w40) -> (task ID out=w41, error out=w42)
    call "Sound Output Write.gvi"(task ID in=w41, data=w37, error in=w42, timeout (sec)=3) -> (task ID out=w43, error out=w44)
    call "Sound Output Start.gvi"(task ID in=w43, error in=w44) -> (task ID out=w45, error out=w46)
    call "Sound Output Wait.gvi"(task ID in=w45, error in=w46, timeout=3) -> (task ID out=w47, error out=w48)
    call "Sound Output Stop.gvi"(task ID in=w47, error in=w48) -> (task ID out=w49, error out=w50)
    call "Sound Output Clear.gvi"(task ID=w49, error in=w50)
  }
  $"Error-Impacted Signal" <- w16
  $"RLS Output" <- w24
  # Write the noisy speech to a text file
  $"Error-Corrected Signal" <- w8
  $"RLS Output without Hampell" <- w32
