vi "MFG_ENB_EE3001_Rx.gvi"   [LabVIEW Communications System Design Software 2.0.1]
panel controls:
  "IQ rate": f64 = 400000
  "carrier frequency": f64 = 915000000
  "gain (dB)": f64
  "active antenna": string = "RX2"
  "symbol rate (sym/s)": i64 = 10000
  "Device names": string = "NI2900RX"
  "adc.m path": path = path "C:\\Users\\MSI\\Documents\\MATLAB\\5\\EE3001\\MATLAB Exercises\\Project\\newsound"
  "Noise Selection": T1 = "Drill Noise 1"
panel indicators:
  "actual IQ rate": f64
  "actual carrier frequency": f64
  "actual gain (dB)": f64
  "Baseband Output": cluster{"t0": f64, "dt": f64, "Y": f64[]}
  "Eye Diagram": cluster{"t0": f64, "dt": f64, "Y": f64[]}[]
  "Error-Corrected Signal": f64[]
  "SOFT BER ≈ SER": f64
  "HARD BER": f64
  "Error-Impacted Signal": f64[]
  "Number of errors without correction": f64
  "With soft decision correction": f64
  "With hard decision correction": f64
  "RLS Output with Hampel Filter": f64[]
  "RLS Output without Hampel Filter": f64[]
  "Bandwith Efficiency": f64
  "SNR": c128
types:
  T1 = enum{"Drill Noise 1", "Drill Noise 2", "Drill Noise 3", "Drill Noise 4", "Fan Noise", "Chainsaw Noise"}
  T2 = cluster{"whole seconds": u64, "fractional seconds": f64}
  "filter structure.gtype" = u32
  "filter.gtype" = cluster{"filter structure": "filter structure.gtype", "forward coefficients": f64[], "reverse coefficients": f64[], "sampling frequency": f64}
  "Sound Data Format.gtype" = cluster{"sample rate (S/s)": f64, "number of channels": i32, "bits per sample": i32}
uses:
  NI::Analysis::Conditioning::Unwrap Phase.gvi
  NI::Analysis::Filtering::Filtering with Initial Conditions (DBL).gvi
  NI::Analysis::Operations::1D Convolution (DBL).gvi
  NI::Analysis::Resampling::Decimate (single shot, DBL).gvi
  NI::Analysis::Conditioning::Shift Array.gvi
  NI::Analysis::Statistics::RMS (DBL).gvi
diagram:
  Math Node() -> ("Befficiency"=w1)
  ~~~
  Rb=224000;
  deltaf=5000;
  B= deltaf + (1 + 0.5)*Rb;

  Befficiency = Rb/B;
  ~~~
  $"Bandwith Efficiency" <- w1
  call "niUSRP Open Rx Session.gvi"(niUSRP Device=$"Device names", reset=TRUE) -> (error out=w2, session handle out=w3)
  call "niUSRP Configure Signal.gvi"(session handle=w3, IQ rate=$"IQ rate", carrier frequency=$"carrier frequency", gain=$"gain (dB)", error in (no error)=w2, active antenna=$"active antenna") -> (session handle out=w4, coerced IQ rate=w5, coerced carrier frequency=w6, coerced gain=w7, Error Out=w8)
  Divide(x=w5, y=$"symbol rate (sym/s)") -> w9
  call "niUSRP Configure Time Start Trigger.gvi"(session handle=w4, start trigger time=T2 {"whole seconds"=20, "fractional seconds"=0}, error in (no error)=w8) -> (session handle out=w10, Error Out=w11)
  call "niUSRP Initiate.gvi"(session handle=w10, error in (no error)=w11) -> (session handle out=w12, Error Out=w13)
  # number of samples
  Multiply(224000, w9) -> w14
  call "niUSRP Fetch Rx Data (CDB Cluster).gvi"(session handle=w12, number of samples=w14, timeout=50, error in (no error)=w13) -> (session handle out=w15, data=w16, Error Out=w17)
  Property Node(instance in=w16) -> ("dt"=w18, "Y"=w19)
  call "MT Generate Filter Coefficients.gvi"(pulse shaping filter="none", matched samples per symbol=w9, modulation type="FSK") -> (matched filter coefficients=w20)
  # samples/symbol = Decimation Factor
  Property Node(instance in="filter.gtype" {all zero or empty}, "filter structure"=3, "forward coefficients"=[1, -1], "reverse coefficients"=[1, -1]) -> (instance out=w21)
  Complex To Polar(r * e^(i*theta)=w19) -> (theta=w22)
  call "Unwrap Phase.gvi"(input phase=w22, phase unit="degree in, radian out"(3)) -> (unwrapped phase=w23)
  call "Filtering with Initial Conditions (DBL).gvi"(signal=w23, filter=w21) -> (filtered signal=w24)
  call "Median Filter2.gvi"(X=w24, left rank=5) -> (Filtered X=w25)
  call "1D Convolution (DBL).gvi"(x=w25, y=w20) -> (x * y=w26)
  w27 = cluster{"t0": f64, "dt": f64, "Y": f64[]} {all zero or empty}
  Property Node(instance in=w27, "dt"=w18, "Y"=w26) -> (instance out=w28)
  call "PulseAlign(real).gvi"(Input Signal=w28, Receiver Sampling Factor=w9) -> (Aligned Signal=w29)
  Property Node(instance in=w29) -> ("Y"=w30)
  call "Decimate (single shot, DBL).gvi"(input array=w30, decimating factor=w9) -> (decimated array=w31)
  Is Greater(x=w31, y=0) -> w32
  Boolean To Integer(Boolean=w32) -> (0, 1=w33)
  Array Subset(array=w33, index0=0, length0=224000) -> w34
  call "Shift Array.gvi"(input array=w34, number of shifts=-1) -> (shifted array=w35)
  Path To String(path=$"adc.m path") -> (string=w36)
  Concatenate Strings(w36, "\\adc.txt") -> w37
  String To Path(string=w37) -> (path=w38)
  # Read the original bitstream without error
  while {
    Wait(time to wait=200)
    Open Or Create Or Replace File(file path (use dialog)=w38) -> (error out=w39)
    call "Is Error.gvi"(error in=w39) -> (is error?=w40)
    Not(x=w40) -> w41
    stop if w41
  }
  call "Read from Spreadsheet File (DBL).gvi"(file path=w38) -> (all rows=w42)
  Array Index(array=w42) -> (out0[_, 0]=w43)
  # Hamming code implementation
  Math Node("decimalToBinary"=w43, "cwordArray"=w35) -> ("output"=w44, "BERsoft"=w45, "BERhard"=w46, "errored"=w47, "Nerrs"=w48, "Nsoftbiterrs"=w49, "Nhardbiterrs"=w50)
  ~~~
  cwords = [
      0     0     0     0     0     0     0;
      0     0     0     1     0     1     1;
      0     0     1     0     1     1     0;
      0     0     1     1     1     0     1;
      0     1     0     0     1     1     1;
      0     1     0     1     1     0     0;
      0     1     1     0     0     0     1;
      0     1     1     1     0     1     0;
      1     0     0     0     1     0     1;
      1     0     0     1     1     1     0;
      1     0     1     0     0     1     1;
      1     0     1     1     0     0     0;
      1     1     0     0     0     1     0;
      1     1     0     1     0     0     1;
      1     1     1     0     1     0     0;
      1     1     1     1     1     1     1];

  Nerrs = 0; Nsoftbiterrs = 0; Nhardbiterrs = 0; Nblocks = 32000; k = 4; n = 7;

  EbNodB = 6;
  R = 4/7;

  EbNo = 10 ^ (EbNodB / 10);
  sigma = sqrt(1 / (2 * R * EbNo));
  %sigma = 0;

  cwordArray = reshape(cwordArray, 7, 32000)';
  decimalToBinary = reshape(decimalToBinary, 4, 32000)';

  output = zeros(128000,1);
  errored = zeros(128000,1);
  for i = 1 : Nblocks
      msg = decimalToBinary(i, :);
      cword = cwordArray(i, :);
      s = 1 - 2 * cword;
      r = s + sigma * randn(1, n);

      b = (r < 0);
      errored((4*i-3):(4*i)) = b(1:4);
      %%% Hard decision
      dist = mod(repmat(b, 16, 1) + cwords,2) * ones(7, 1);
      [mind1, pos] = min(dist);
      msg_cap1 = cwords(pos, 1:4);

      %%% Soft decision
      corr = (1 - 2 * cwords) * r';
      [mind2, pos] = max(corr);
      msg_cap2 = cwords(pos, 1:4);

      Nbiterrs = sum(msg ~= b(1:4));
      Nharderrs = sum(msg ~= msg_cap1);
      Nsofterrs = sum(msg ~= msg_cap2);

      if Nbiterrs > 0
          Nerrs = Nerrs + Nbiterrs;
      end
      if Nsofterrs > 0
          Nsoftbiterrs = Nsoftbiterrs + Nsofterrs;
      end
      if Nharderrs > 0
          Nhardbiterrs = Nhardbiterrs + Nharderrs;
      end

      output((4*i-3):(4*i)) = msg_cap2;
  end
  Nsoftbiterrs = Nsoftbiterrs(1);

  BERsoft = Nsoftbiterrs/k/Nblocks;
  BERhard = Nhardbiterrs/k/Nblocks;
  ~~~
  Math Node("p"=w45) -> ("SNR_dB"=w51)
  ~~~
  % p = BERsoft (giriş olarak yukarıdan alırsın)
  R = 4/7

  plow = 0.02425;
  phigh = 1 - plow;

  a1 = -39.69683028665376;
  a2 = 220.9460984245205;
  a3 = -275.9285104469687;
  a4 = 138.3577518672690;
  a5 = -30.66479806614716;
  a6 = 2.506628277459239;

  b1 = -54.47609879822406;
  b2 = 161.5858368580409;
  b3 = -155.6989798598866;
  b4 = 66.80131188771972;
  b5 = -13.28068155288572;

  c1 = -0.007784894002430293;
  c2 = -0.3223964580411365;
  c3 = -2.400758277161838;
  c4 = -2.549732539343734;
  c5 = 4.374664141464968;
  c6 = 2.938163982698783;

  d1 = 0.007784695709041462;
  d2 = 0.3224671290700398;
  d3 = 2.445134137142996;
  d4 = 3.754408661907416;

  if (p < plow)
      q = sqrt(-2 * log(p));
      qinv_val = (((((c1*q + c2)*q + c3)*q + c4)*q + c5)*q + c6) / ...
                 ((((d1*q + d2)*q + d3)*q + d4)*q + 1);
  elseif (p <= phigh)
      q = p - 0.5;
      r = q*q;
      qinv_val = (((((a1*r + a2)*r + a3)*r + a4)*r + a5)*r + a6)*q / ...
                 (((((b1*r + b2)*r + b3)*r + b4)*r + b5)*r + 1);
  else
      q = sqrt(-2 * log(1 - p));
      qinv_val = -(((((c1*q + c2)*q + c3)*q + c4)*q + c5)*q + c6) / ...
                   ((((d1*q + d2)*q + d3)*q + d4)*q + 1);
  end

  % Şimdi Eb/No ve SNR hesapla
  EbNo = 0.5*qinv_val^2;
  SNR_dB = 10 * log10(R * EbNo);
  ~~~
  $SNR <- w51
  $"SOFT BER ≈ SER" <- w45
  call "niUSRP Abort.gvi"(Handle in=w15, error in (no error)=w17) -> (Handle out=w52, Error Out=w53)
  call "niUSRP Close Session.gvi"(handle in=w52, error in=w53) -> (error out=w54)
  call "Simple Error Handler.gvi"(error in=w54)
  $"HARD BER" <- w46
  $"Number of errors without correction" <- w48
  $"With soft decision correction" <- w49
  $"Baseband Output" <- w28
  $"With hard decision correction" <- w50
  $"actual IQ rate" <- w5
  Array Index(array=w44) -> (out0[_, 0]=w55)
  Reshape Array(inArray=w55, size=8000, size=16) -> w56
  Array Index(array=w47) -> (out0[_, 0]=w57)
  Reshape Array(inArray=w57, size=8000, size=16) -> w58
  # Binary to decimal conversion
  Math Node("decimalToBinary"=w56, "errored"=w58) -> ("errorCorrected"=w59, "erroredSignal"=w60)
  ~~~
      partition = linspace(-1, 1, pow2(16));

      b2d = zeros(8000, 1);
      erroredb2d = zeros(8000, 1);
      for i = 1 : length(decimalToBinary)
          b2d(i, :) = sum(decimalToBinary(i, :) .* pow2(15:-1:0));
          erroredb2d(i, :) = sum(errored(i, :) .* pow2(15:-1:0));
      end

      b2d(b2d == 0) = 1;
      erroredb2d(erroredb2d == 0) = 1;

      errorCorrected = zeros(8000, 1);
      erroredSignal = zeros(8000, 1);
      for i = 1 : length(b2d)
          errorCorrected(i) = partition(b2d(i));
          erroredSignal(i) = partition(erroredb2d(i));
      end
  ~~~
  Array Index(array=w60) -> (out0[_, 0]=w61)
  Array Index(array=w59) -> (out0[_, 0]=w62)
  Subtract(x=w61, y=w62) -> w63
  call "RMS (DBL).gvi"(x=w63) -> (rms value=w64)
  Square(x=w64) -> w65
  call "RMS (DBL).gvi"(x=w62) -> (rms value=w66)
  Square(x=w66) -> w67
  Divide(x=w67, y=w65) -> w68
  Logarithm Base 10(x=w68) -> w69
  Multiply(10, w69)
  $"actual carrier frequency" <- w6
  $"actual gain (dB)" <- w7
  w70 = $"adc.m path"
  Path To String(path=w70) -> (string=w71)
  Concatenate Strings(w71, "\\noisySpeech.txt") -> w72
  String To Path(string=w72) -> (path=w73)
  call "Write to Spreadsheet File (DBL).gvi"(file path=w73, 1D data=w62) -> (new file path=w74)
  while {
    Wait(time to wait=200)
    Open Or Create Or Replace File(file path (use dialog)=w74) -> (error out=w75)
    call "Is Error.gvi"(error in=w75) -> (is error?=w76)
    Not(x=w76) -> w77
    stop if w77
  }
  Path To String(path=w70) -> (string=w78)
  Concatenate Strings(w78, "\\rlsOutput.txt") -> w79
  String To Path(string=w79) -> (path=w80)
  while {
    Wait(time to wait=200)
    Open Or Create Or Replace File(file path (use dialog)=w80) -> (error out=w81)
    call "Is Error.gvi"(error in=w81) -> (is error?=w82)
    Not(x=w82) -> w83
    stop if w83
  }
  call "Read from Spreadsheet File (DBL).gvi"(file path=w80) -> (all rows=w84)
  Array Index(array=w84) -> (out0[_, 0]=w85)
  Build Array(w61, w62, w85) -> w86
  # Play the sounds
  for {
    w87 = each element of w86
    Build Waveform Node(Y=w87) -> (output waveform=w88)
    Build Array(w88) -> w89
    w90 = "Sound Data Format.gtype" {"sample rate (S/s)"=8000, "number of channels"=1, "bits per sample"=16}
    call "Sound Output Configure.gvi"(device ID=0, sound format=w90) -> (task ID=w91, error out=w92)
    call "Sound Output Start.gvi"(task ID in=w91, error in=w92) -> (task ID out=w93, error out=w94)
    call "Sound Output Write.gvi"(task ID in=w93, data=w89, error in=w94, timeout (sec)=3) -> (task ID out=w95, error out=w96)
    call "Sound Output Start.gvi"(task ID in=w95, error in=w96) -> (task ID out=w97, error out=w98)
    call "Sound Output Wait.gvi"(task ID in=w97, error in=w98, timeout=3) -> (task ID out=w99, error out=w100)
    call "Sound Output Stop.gvi"(task ID in=w99, error in=w100) -> (task ID out=w101, error out=w102)
    call "Sound Output Clear.gvi"(task ID=w101, error in=w102)
  }
  $"Error-Impacted Signal" <- w61
  $"RLS Output with Hampel Filter" <- w85
  Array Subset(array=w26, index0=0, length0=100000) -> w103
  w104 = cluster{"t0": f64, "dt": f64, "Y": f64[]} {all zero or empty}
  Property Node(instance in=w104, "dt"=w18, "Y"=w103) -> (instance out=w105)
  call "MT Format Eye Diagram (complex).gvi"(waveform=w105, symbol rate=$"symbol rate (sym/s)", eye length=2) -> (eye diagram=w106)
  $"Eye Diagram" <- w106
  # Write the noisy speech to a text file
  $"Error-Corrected Signal" <- w62
  # Read the RLS output text file created by MATLAB
  Path To String(path=w70) -> (string=w107)
  Concatenate Strings(w107, "\\rlsOutput_raw.txt") -> w108
  String To Path(string=w108) -> (path=w109)
  while {
    Wait(time to wait=20000)
    Open Or Create Or Replace File(file path (use dialog)=w109) -> (error out=w110)
    call "Is Error.gvi"(error in=w110) -> (is error?=w111)
    Not(x=w111) -> w112
    stop if w112
  }
  call "Read from Spreadsheet File (DBL).gvi"(file path=w109, transpose?=FALSE) -> (all rows=w113)
  Array Index(array=w113) -> (out0[_, 0]=w114)
  $"RLS Output without Hampel Filter" <- w114
  Number To Decimal String(number=$"Noise Selection") -> (decimal integer string=w115)
  Concatenate Strings("matlab -batch \"rls ", w115, "; exit\"") -> w116
  # Run the RLS function in MATLAB by giving the selected reference noise as input
  call "System Exec.gvi"(command line=w116, working directory=w70, run minimized?=TRUE)
