vi "MFG_ENB_EE3001_Tx.gvi"   [LabVIEW Communications System Design Software 2.0.1]
panel controls:
  "IQ rate": f64 = 400000
  "carrier frequency": f64 = 915000000
  "gain (dB)": f64
  "active antenna": string = "TX1"
  "symbol rate (sym/s)": i32 = 10000
  "pulse shaping filter": T2 = "none"
  "adc.m path": path = path "C:\\Users\\MSI\\Documents\\MATLAB\\5\\EE3001\\MATLAB Exercises\\Project\\newsound"
  "Device names": string = "NI2900RX"
  "Noise Selection": T3 = "Drill Noise 1"
panel indicators:
  "actual IQ rate": f64
  "actual carrier frequency": f64
  "actual gain (dB)": f64
  "source bit stream": i8[]
  "Baseband Power Spectrum": T1
  "Message Waveform (Binary)": f64[]
  "Message Waveform Data": f64[]
types:
  T1 = cluster{"f0": f64, "df": f64, "magnitude": f64[]}
  T2 = enum{"none", "Raised Cosine", "Root Raised Cos", "Gaussian"}
  T3 = enum{"Drill Noise 1", "Drill Noise 2", "Drill Noise 3", "Drill Noise 4", "Fan Noise", "Chainsaw Noise"}
  T4 = cluster{"whole seconds": u64, "fractional seconds": f64}
  "filter structure.gtype" = u32
  "filter.gtype" = cluster{"filter structure": "filter structure.gtype", "forward coefficients": f64[], "reverse coefficients": f64[], "sampling frequency": f64}
  "Sound Data Format.gtype" = cluster{"sample rate (S/s)": f64, "number of channels": i32, "bits per sample": i32}
uses:
  NI::Analysis::Resampling::Upsample (DBL).gvi
  NI::Analysis::Operations::1D Convolution (DBL).gvi
  NI::Analysis::Filtering::Filtering with Initial Conditions (DBL).gvi
diagram:
  Number To Decimal String(number=$"Noise Selection") -> (decimal integer string=w1)
  Concatenate Strings("matlab -batch \"adc ", w1, "; exit\"") -> w2
  call "System Exec.gvi"(command line=w2, working directory=$"adc.m path", run minimized?=TRUE)
  # Delete the existing files
  Path To String(path=$"adc.m path") -> (string=w3)
  Concatenate Strings(w3, "\\rlsOutput.txt") -> w4
  String To Path(string=w4) -> (path=w5)
  Delete File Or Folder(path (use dialog)=w5)
  # Run the ADC on MATLAB
  Path To String(path=$"adc.m path") -> (string=w6)
  Concatenate Strings(w6, "\\adc.txt") -> w7
  String To Path(string=w7) -> (path=w8)
  # Read the ADC file generated by MATLAB
  while {
    Wait(time to wait=200)
    Open Or Create Or Replace File(file path (use dialog)=w8) -> (error out=w9)
    call "Is Error.gvi"(error in=w9) -> (is error?=w10)
    Not(x=w10) -> w11
    stop if w11
  }
  while {
    call "Read from Spreadsheet File (DBL).gvi"(file path=w8) -> (all rows=w12)
    Array Index(array=w12) -> (out0[_, 0]=w13)
    Is Empty Array(array=w13) -> w14
    Wait(time to wait=200)
    continue if w14
  }
  # Add parity bits to the data
  Math Node("decimalToBinary"=w13) -> ("cwordArray"=w15)
  ~~~
  EbNodB = 4;
  R = 4/7;

  EbNo = 10 ^ (EbNodB / 10);
  sigma = sqrt(1 / (2 * R * EbNo));

  cwords = [0     0     0     0     0     0     0;
      0     0     0     1     0     1     1;
      0     0     1     0     1     1     0;
      0     0     1     1     1     0     1;
      0     1     0     0     1     1     1;
      0     1     0     1     1     0     0;
      0     1     1     0     0     0     1;
      0     1     1     1     0     1     0;
      1     0     0     0     1     0     1;
      1     0     0     1     1     1     0;
      1     0     1     0     0     1     1;
      1     0     1     1     0     0     0;
      1     1     0     0     0     1     0;
      1     1     0     1     0     0     1;
      1     1     1     0     1     0     0;
      1     1     1     1     1     1     1];

  k = 4;
  n = 7;

  Nbiterrs = 0; Nblkerrs = 0; Nblocks = 32000;

  decimalToBinary = reshape(decimalToBinary, 4, 32000)';

  cwordArray = zeros(32000, 7);
  for i = 1 : Nblocks
      msg = decimalToBinary(i, :);
      cword = [msg mod(msg(1) + msg(2) + msg(3), 2)...
          mod(msg(2) + msg(3) + msg(4), 2)...
          mod(msg(1) + msg(2) + msg(4), 2)];
      cwordArray(i, :) = cword;
  end
  cwordArray = reshape(cwordArray',1,224000)';
  ~~~
  $"Message Waveform (Binary)" <- w15
  Path To String(path=$"adc.m path") -> (string=w16)
  Concatenate Strings(w16, "\\adc.txt") -> w17
  String To Path(string=w17) -> (path=w18)
  Delete File Or Folder(path (use dialog)=w18)
  Path To String(path=$"adc.m path") -> (string=w19)
  Concatenate Strings(w19, "\\noisySpeech.txt") -> w20
  String To Path(string=w20) -> (path=w21)
  Delete File Or Folder(path (use dialog)=w21)
  call "niUSRP Open Tx Session.gvi"(Device names=$"Device names") -> (session handle out=w22, Error Out=w23)
  call "niUSRP Configure Signal.gvi"(session handle=w22, IQ rate=$"IQ rate", carrier frequency=$"carrier frequency", gain=$"gain (dB)", error in (no error)=w23, active antenna=$"active antenna") -> (session handle out=w24, coerced IQ rate=w25, coerced carrier frequency=w26, coerced gain=w27)
  call "niUSRP Configure Time Start Trigger.gvi"(session handle=w24, start trigger time=T4 {"whole seconds"=20, "fractional seconds"=0}) -> (session handle out=w28)
  Reciprocal(x=w25) -> w29
  # Upsampling
  Property Node(instance in="filter.gtype" {all zero or empty}, "filter structure"=2, "forward coefficients"=[1], "reverse coefficients"=[1, -1]) -> (instance out=w30)
  # samples/symbol = upsample factor
  Divide(x=w25, y=$"symbol rate (sym/s)") -> w31
  # Pulse Shaping
  call "MT Generate Filter Coefficients.gvi"(pulse shaping filter=$"pulse shaping filter", pulse shaping samples per symbol=w31, modulation type="FSK") -> (pulse shaping filter coefficients=w32)
  Multiply(w15, 2) -> w33
  Decrement(x=w33) -> w34
  call "Upsample (DBL).gvi"(input array=w34, upsampling factor=w31) -> (upsampled array=w35)
  call "1D Convolution (DBL).gvi"(x=w35, y=w32) -> (x * y=w36)
  Absolute Value(x=w36) -> w37
  Array Max And Min(array=w37) -> (max value=w38)
  Divide(x=w36, y=w38) -> w39
  call "Filtering with Initial Conditions (DBL).gvi"(signal=w39, filter=w30) -> (filtered signal=w40)
  Multiply(5000, w40) -> w41
  Multiply(w41, PiTimes2) -> w42
  Multiply(w42, w29) -> w43
  Polar To Complex(r=1, theta=w43) -> (r * e^(i*theta)=w44)
  w45 = cluster{"t0": timestamp, "dt": f64, "Y": c128[]} {all zero or empty}
  Property Node(instance in=w45, "Y"=w44, "dt"=w29) -> (instance out=w46)
  call "FFT Power Spectrum for 1 Chan (CDB)2.gvi"(time signal=w46, dB On (F)=TRUE) -> (power spectrum=w47, Error Out=w48)
  call "niUSRP Write Tx Data (CDB).gvi"(session handle=w28, data=w44, timeout=50, error in (no error)=w48) -> (session handle out=w49, Error Out=w50)
  call "niUSRP Close Session.gvi"(handle in=w49, error in=w50) -> (error out=w51)
  call "Simple Error Handler.gvi"(error in=w51)
  $"source bit stream" <- w15
  $"actual IQ rate" <- w25
  Path To String(path=$"adc.m path") -> (string=w52)
  Concatenate Strings(w52, "\\rlsOutput_raw.txt") -> w53
  String To Path(string=w53) -> (path=w54)
  Delete File Or Folder(path (use dialog)=w54)
  $"actual carrier frequency" <- w26
  $"actual gain (dB)" <- w27
  $"Baseband Power Spectrum" <- w47
  Path To String(path=$"adc.m path") -> (string=w55)
  Concatenate Strings(w55, "\\referenceWithComma.txt") -> w56
  String To Path(string=w56) -> (path=w57)
  call "Read from Spreadsheet File (DBL).gvi"(file path=w57) -> (all rows=w58)
  Array Index(array=w58) -> (out0[_, 0]=w59)
  case ($"Noise Selection") {
    frame "Drill Noise 1" {
      w60 = "\\drillNoise1WithComma.txt"
    }
    frame "Drill Noise 2" {
      w60 = "\\drillNoise2WithComma.txt"
    }
    frame "Drill Noise 3" {
      w60 = "\\drillNoise3WithComma.txt"
    }
    frame "Drill Noise 4" {
      w60 = "\\drillNoise4WithComma.txt"
    }
    frame "Fan Noise" {
      w60 = "\\fanNoiseWithComma.txt"
    }
    frame "Chainsaw Noise" {
      w60 = "\\chainsawNoiseWithComma.txt"
    }
  }
  Concatenate Strings(w55, w60) -> w61
  String To Path(string=w61) -> (path=w62)
  call "Read from Spreadsheet File (DBL).gvi"(file path=w62) -> (all rows=w63)
  Array Index(array=w63) -> (out0[_, 0]=w64)
  # Generate the message waveform
  Add(w59, w64) -> w65
  $"Message Waveform Data" <- w65
  Build Array(w65) -> w66
  for {
    w67 = each element of w66
    Build Waveform Node(Y=w67) -> (output waveform=w68)
    Build Array(w68) -> w69
    w70 = "Sound Data Format.gtype" {"sample rate (S/s)"=8000, "number of channels"=1, "bits per sample"=16}
    call "Sound Output Configure.gvi"(device ID=0, sound format=w70) -> (task ID=w71, error out=w72)
    call "Sound Output Start.gvi"(task ID in=w71, error in=w72) -> (task ID out=w73, error out=w74)
    call "Sound Output Write.gvi"(task ID in=w73, data=w69, error in=w74) -> (task ID out=w75, error out=w76)
    call "Sound Output Start.gvi"(task ID in=w75, error in=w76) -> (task ID out=w77, error out=w78)
    call "Sound Output Wait.gvi"(task ID in=w77, error in=w78) -> (task ID out=w79, error out=w80)
    call "Sound Output Stop.gvi"(task ID in=w79, error in=w80) -> (task ID out=w81, error out=w82)
    call "Sound Output Clear.gvi"(task ID=w81, error in=w82)
  }
